# Grasshopper definition axis_generator.gh (Grasshopper 1.0.7)
# plug-ins: Pufferfish

beam_thickness_mm = Slider(12, range=0..100)

# ---- group: Rack Generator
# curve tail
# Repeating Wave
number_of_teeth = Slider(46, range=0..500)
rack_width_mm_1inch = Slider(15, range=0..100)
start = Curve([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])
brec = BoundingRectangle(Geometry=start, Plane=PlaneXY(0, 0, 0), Axis=0, Slide=0, Union=True)  # -> Bounding, DimensionX, DimensionY
holes_count = Slider(18, range=0..100)
holes_step = Slider(20, range=0..100)
hole_d = Slider(3, range=0..8)
vec = VectorXYZ(XComponent=brec.DimensionX, YComponent=0, ZComponent=0)  # -> Vector, Length
arrlinear = LinearArray(Geometry=start, Direction=vec.Vector, Count=number_of_teeth)  # -> Geometry, Transform
series = Series(Start=0, Step=holes_step, Count=expr("x/2", holes_count))
join = JoinCurves(Curves=flatten(arrlinear.Geometry), Preserve=False)
neg = Negative(Value=series)
curvepoint = PointOnCurve(join, parameter=0)
start_2 = Curve(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)
X = UnitX(Factor=[neg, series])
curvepoint_2 = PointOnCurve(start_2, parameter=1)
move2pt = MoveToPoint(Geometry=start_2, PointA=curvepoint_2, PointB=curvepoint)  # -> Moved, Vector, Transform
neg_2 = Negative(Value=rack_width_mm_1inch)
join_2 = JoinCurves(Curves=flatten([join, move2pt.Moved]), Preserve=False)
Y = UnitY(Factor=neg_2)
curvepoint_3 = PointOnCurve(join_2, parameter=0)
curvepoint_4 = PointOnCurve(join_2, parameter=1)
move = Move(Geometry=curvepoint_3, Motion=Y)  # -> Geometry, Transform
move_2 = Move(Geometry=curvepoint_4, Motion=Y)  # -> Geometry, Transform
ln = Line(StartPoint=curvepoint_3, EndPoint=move.Geometry)
ln_2 = Line(StartPoint=move.Geometry, EndPoint=move_2.Geometry)
len = Length(Curve=ln_2)
length_of_the_rack_mm = Panel(len)
ln_3 = Line(StartPoint=curvepoint_4, EndPoint=move_2.Geometry)
merge = Merge(Data1=ln, Data2=ln_2, Data3=ln_3, Data5=join_2)
join_3 = JoinCurves(Curves=flatten(merge), Preserve=False)
area = Area(Geometry=join_3)  # -> Area, Centroid
cir = Circle(Plane=area.Centroid, Radius=expr("x/2", hole_d))
move_3 = Move(Geometry=cir, Motion=X)  # -> Geometry, Transform
group = Group(Objects=flatten([join_3, move_3.Geometry]))

# ----
beam_width_mm = Slider(50, range=0..100)
Z = UnitZ(Factor=beam_thickness_mm)
pt = ConstructPoint(XCoordinate=length_of_the_rack_mm, YCoordinate=beam_width_mm, ZCoordinate=0)
rec_2pt = Rectangle2Pt(Plane=PlaneXY(0, 0, 0), PointA=move_2.Geometry, PointB=pt, Radius=0)  # -> Rectangle, Length
boundary = BoundarySurfaces(Edges=flatten([rec_2pt.Rectangle, move_3.Geometry]))
extr = Extrude(Base=boundary, Direction=Z)
depth_of_the_holes = Slider(6, range=0..10)
area_2 = Area(Geometry=move_3.Geometry)  # -> Area, Centroid
cyl = Cylinder(Base=area_2.Centroid, Radius=expr("x+1", hole_d), Length=depth_of_the_holes)
cap = CapHoles(Brep=cyl)
sdiff = SolidDifference(BrepsA=extr, BrepsB=cap)
